# Grasshopper definition grasshopper_to_place_cone.gh (Grasshopper 1.0.8)

pt = Point(Point(0, 0, 0))
number_slider = Slider(150, range=0..5000)
number_slider_2 = Slider(80, range=0..1000)
number_slider_3 = Slider(406.4, range=0..1000)
brep = Brep(<brep referenced from the Rhino model>)
series = Series(Start=0, Step=Slider(200, range=0..1000), Count=Slider(5, range=1..50))
pt_2 = ConstructPoint(XCoordinate=number_slider_2, YCoordinate=number_slider, ZCoordinate=0)
subtraction = Subtraction(A=number_slider_3, B=number_slider_2)
addition = Addition(A=number_slider, B=Slider(157, range=-1000..1000))
rectangle = Rectangle(Plane=PlaneXY(0, 0, 0), XSize=number_slider_3, YSize=Slider(2679.7, range=0..5000), Radius=0)  # -> Rectangle, Length
vec2pt = Vector2Pt(PointA=pt, PointB=pt_2, Unitize=False)  # -> Vector, Length
pt_3 = ConstructPoint(XCoordinate=subtraction, YCoordinate=addition, ZCoordinate=0)
Y = UnitY(Factor=series)
move = Move(Geometry=brep, Motion=vec2pt.Vector)  # -> Geometry, Transform
vec2pt_2 = Vector2Pt(PointA=pt, PointB=pt_3, Unitize=False)  # -> Vector, Length
move_2 = Move(Geometry=brep, Motion=vec2pt_2.Vector)  # -> Geometry, Transform
merge = Merge(Data1=move.Geometry, Data2=move_2.Geometry)
move_3 = Move(Geometry=graft(merge), Motion=Y)  # -> Geometry, Transform
preview = CustomPreview(Geometry=move_3.Geometry, Material=ColourSwatch(SwatchColor=RGB(54, 91, 186)))
